# Grasshopper definition BrickGameLiveInGrasshopper+.gh (Grasshopper 1.0.7)

# ---- group: STEP 2 - BAT
number_slider = Slider(40, range=0..100)  # disabled
number_slider_2 = Slider(60, range=0..100)  # disabled
md_slider = MDSlider(
    SliderMode=0,
    slider_value=Point(0.2619481901, 0.8283501602, 0.5),
    x_domain=Domain(0, 1),
    y_domain=Domain(0, 1),
    z_domain=Domain(0, 1))  # disabled
vec = VectorXYZ(XComponent=10, YComponent=2, ZComponent=5)  # -> Vector, Length; disabled
pt = Point(<point referenced from the Rhino model>)  # disabled
box = Box({Plane=Plane(origin=(-200, -200, 1.440895861e-06), x=(0, 1, 0), y=(1, 0, 0)), X=Domain(0, 400), Y=Domain(0, 400), Z=Domain(-127.9999981, 0)})  # disabled
dom = ConstructDomain(DomainStart=expr("x*-1", number_slider), DomainEnd=number_slider)  # disabled
dom_2 = ConstructDomain(DomainStart=expr("x*-1", number_slider_2), DomainEnd=number_slider_2)  # disabled
pdecon = Deconstruct(Point=md_slider)  # -> XComponent, YComponent, ZComponent; disabled
pyballsetup = GhPythonScript(pt=pt, vec=vec.Vector, box=box)  # -> out, myBall; inputs pt: Point3d, vec: Vector3d; disabled
# ---------- pyballsetup: Python ----------
__author__ = "maeta"
__version__ = "2020.08.29"

import rhinoscriptsyntax as rs

class Ball():
    def __init__(self, _coor, _vec, _boundingbox):
        self.coor = _coor
        self.vec  = _vec
        self.bbox = _boundingbox
        
    def move(self,bat):
        self.updateVec(bat)
        self.coor = rs.PointAdd(self.coor,self.vec)
        
    def updateVec(self, bat):#, myRipple, plateID, gen, i, batID, widX, widY, run
        #result = "keep"
        #if self.coor[2] >= self.bbox[4][2]:
            #self.vec[2] = -self.vec[2]
            #closePt = rs.MeshClosestPoint(plateID,self.coor)[0]#2 outputs
            #index = rs.PointArrayClosestPoint(myRipple.vtxs, closePt)
            #result = index
        if self.coor[0] >= self.bbox[1][0] or self.coor[0] <= self.bbox[0][0]:
            self.vec[0] = -self.vec[0]
        if self.coor[1] >= self.bbox[2][1] or self.coor[1] <= self.bbox[0][1]:
            self.vec[1] = -self.vec[1]
        if self.coor[2] >= self.bbox[4][2]:
            self.vec[2] = -self.vec[2]
        if self.coor[2] <= self.bbox[0][2]:
            pt = rs.CreatePoint(self.coor[0],self.coor[1],0)
            print bat.Contains(pt)
            self.vec = rs.CreateVector(0,0,0)
        
            """  #ball drops down
            if batID.coor[0] - 0.5*widX <= self.coor[0] <= batID.coor[0] - 0.5*widX and  batID.coor[1] - 0.5*widY <= self.coor[1] <= batID.coor[1] - 0.5*widY :
                self.vec[2] = -self.vec[2]
            else:
                run = False
            """
            
        #return result#, run
    
bbox = rs.BoundingBox(box)
myBall = Ball(pt,vec,bbox)
# ---------- end pyballsetup ----------
timer = Timer(Interval=20, TimerInterval=20, Target=pyballrun)  # disabled
box_2 = EvaluateBox(Box=box, UParameter=pdecon.YComponent, VParameter=pdecon.XComponent, WParameter=1)  # -> Plane, Point, Include; disabled
rectangle = Rectangle(Plane=box_2.Point, XSize=dom_2, YSize=dom, Radius=0)  # -> Rectangle, Length; disabled
pyballrun = GhPythonScript(myBall=pyballsetup.myBall, bat=rectangle.Rectangle)  # -> out, pt; inputs bat: Rectangle3d; disabled
# ---------- pyballrun: Python ----------
__author__ = "maeta"
__version__ = "2020.08.29"

import rhinoscriptsyntax as rs

myBall.move(bat)
pt = myBall.coor
# ---------- end pyballrun ----------
panel = Panel(pyballrun.out)  # disabled
number_slider_3 = Slider(3, range=0..10)  # disabled
sph = Sphere(Base=pyballrun.pt, Radius=number_slider_3)  # disabled

# ---- group: STEP 1 BALL BOUNCE
vec_2 = VectorXYZ(XComponent=10, YComponent=2, ZComponent=5)  # -> Vector, Length; disabled
pt_2 = Point(<point referenced from the Rhino model>)  # disabled
box_3 = Box({Plane=Plane(origin=(-200, -200, 1.440895861e-06), x=(0, 1, 0), y=(1, 0, 0)), X=Domain(0, 400), Y=Domain(0, 400), Z=Domain(-127.9999981, 0)})  # disabled
pyballsetup_2 = GhPythonScript(pt=pt_2, vec=vec_2.Vector, box=box_3)  # -> out, myBall; inputs pt: Point3d, vec: Vector3d; disabled
# ---------- pyballsetup_2: Python ----------
__author__ = "maeta"
__version__ = "2020.08.29"

import rhinoscriptsyntax as rs

class Ball():
    def __init__(self, _coor, _vec, _boundingbox):
        self.coor = _coor
        self.vec  = _vec
        self.bbox = _boundingbox
        
    def move(self):
        self.updateVec()
        self.coor = rs.PointAdd(self.coor,self.vec)
        
    def updateVec(self):#, myRipple, plateID, gen, i, batID, widX, widY, run
        #result = "keep"
        #if self.coor[2] >= self.bbox[4][2]:
            #self.vec[2] = -self.vec[2]
            #closePt = rs.MeshClosestPoint(plateID,self.coor)[0]#2 outputs
            #index = rs.PointArrayClosestPoint(myRipple.vtxs, closePt)
            #result = index
        if self.coor[0] >= self.bbox[1][0] or self.coor[0] <= self.bbox[0][0]:
            self.vec[0] = -self.vec[0]
        if self.coor[1] >= self.bbox[2][1] or self.coor[1] <= self.bbox[0][1]:
            self.vec[1] = -self.vec[1]
        if self.coor[2] <= self.bbox[0][2] or self.coor[2] >= self.bbox[4][2]:
            self.vec[2] = -self.vec[2]
            """  #ball drops down
            if batID.coor[0] - 0.5*widX <= self.coor[0] <= batID.coor[0] - 0.5*widX and  batID.coor[1] - 0.5*widY <= self.coor[1] <= batID.coor[1] - 0.5*widY :
                self.vec[2] = -self.vec[2]
            else:
                run = False
            """
            
        #return result#, run
    
bbox = rs.BoundingBox(box)
print bbox
myBall = Ball(pt,vec,bbox)
# ---------- end pyballsetup_2 ----------
timer_2 = Timer(Interval=20, TimerInterval=20, Target=pyballrun_2)  # disabled
number_slider_4 = Slider(3, range=0..10)  # disabled
pyballrun_2 = GhPythonScript(myBall=pyballsetup_2.myBall)  # -> out, pt; disabled
# ---------- pyballrun_2: Python ----------
__author__ = "maeta"
__version__ = "2020.08.29"

import rhinoscriptsyntax as rs

myBall.move()
pt = myBall.coor
# ---------- end pyballrun_2 ----------
sph_2 = Sphere(Base=pyballrun_2.pt, Radius=number_slider_4)  # disabled

# ---- group: FINISHED GAME / Bat / Control the Bat!!!
md_slider_2 = MDSlider(
    SliderMode=0,
    slider_value=Point(0.6378612984, 0.3105197069, 0.5),
    x_domain=Domain(0, 1),
    y_domain=Domain(0, 1),
    z_domain=Domain(0, 1))

# ---- group: FINISHED GAME / Activate Me!
timer_3 = Timer(Interval=20, TimerInterval=20, Target=pyballrun_3)  # disabled

# ---- group: FINISHED GAME
# GAME CONTROLS
new_game = Button()
vec_3 = VectorXYZ(XComponent=10, YComponent=2, ZComponent=5)  # -> Vector, Length
pt_3 = Point(Point(56, 56, 28))
box_4 = Box({Plane=Plane(origin=(-200, -200, 1.440895861e-06), x=(0, 1, 0), y=(1, 0, 0)), X=Domain(0, 400), Y=Domain(0, 400), Z=Domain(-127.9999981, 0)})
pyballsetup_3 = GhPythonScript(pt=pt_3, vec=vec_3.Vector, box=box_4, reset=new_game)  # -> out, myBall; inputs pt: Point3d, vec: Vector3d
# ---------- pyballsetup_3: Python ----------
__author__ = "Shawn Wang"
__version__ = "2020.08.29"

import rhinoscriptsyntax as rs

class Ball():
    def __init__(self, _coor, _vec, _boundingbox):
        self.coor = _coor
        self.vec  = _vec
        self.bbox = _boundingbox
        
    def move(self,bat):
        self.updateVec(bat)
        self.coor = rs.PointAdd(self.coor,self.vec)
        
    def updateVec(self, bat):#, myRipple, plateID, gen, i, batID, widX, widY, run
        #result = "keep"
        #if self.coor[2] >= self.bbox[4][2]:
            #self.vec[2] = -self.vec[2]
            #closePt = rs.MeshClosestPoint(plateID,self.coor)[0]#2 outputs
            #index = rs.PointArrayClosestPoint(myRipple.vtxs, closePt)
            #result = index
        if self.coor[0] >= self.bbox[1][0] or self.coor[0] <= self.bbox[0][0]:
            self.vec[0] = -self.vec[0]
        if self.coor[1] >= self.bbox[2][1] or self.coor[1] <= self.bbox[0][1]:
            self.vec[1] = -self.vec[1]
        if self.coor[2] >= self.bbox[4][2]:
            self.vec[2] = -self.vec[2]
        if self.coor[2] <= self.bbox[0][2]:
            pt = rs.CreatePoint(self.coor[0],self.coor[1],0)
            print bat.Contains(pt)
            if str(bat.Contains(pt))=="Inside":
                self.vec[2] = -self.vec[2]
            else:
                #self.vec[2] = -self.vec[2]
                self.vec = rs.CreateVector(0,0,0)
        
            """  #ball drops down
            if batID.coor[0] - 0.5*widX <= self.coor[0] <= batID.coor[0] - 0.5*widX and  batID.coor[1] - 0.5*widY <= self.coor[1] <= batID.coor[1] - 0.5*widY :
                self.vec[2] = -self.vec[2]
            else:
                run = False
            """
            
        #return result#, run
    
bbox = rs.BoundingBox(box)
myBall = Ball(pt,vec,bbox)
# ---------- end pyballsetup_3 ----------
Z = UnitZ(Factor=-2)

# ---- group: FINISHED GAME / Bat
number_slider_5 = Slider(100, range=0..100)
number_slider_6 = Slider(100, range=0..100)
dom_3 = ConstructDomain(DomainStart=expr("x*-1", number_slider_5), DomainEnd=number_slider_5)
dom_4 = ConstructDomain(DomainStart=expr("x*-1", number_slider_6), DomainEnd=number_slider_6)
pdecon_2 = Deconstruct(Point=md_slider_2)  # -> XComponent, YComponent, ZComponent
box_5 = EvaluateBox(Box=box_4, UParameter=pdecon_2.YComponent, VParameter=pdecon_2.XComponent, WParameter=1)  # -> Plane, Point, Include
rectangle_2 = Rectangle(Plane=box_5.Point, XSize=dom_4, YSize=dom_3, Radius=0)  # -> Rectangle, Length

# ----
brep_edges = BrepEdges(Brep=box_4)  # -> Naked, Interior, NonManifold

# ---- group: FINISHED GAME (continued)
pyballrun_3 = GhPythonScript(myBall=pyballsetup_3.myBall, bat=rectangle_2.Rectangle)  # -> out, pt; inputs bat: Rectangle3d
# ---------- pyballrun_3: Python ----------
__author__ = "Shawn Wang"
__version__ = "2020.08.29"

import rhinoscriptsyntax as rs

myBall.move(bat)
pt = myBall.coor
# ---------- end pyballrun_3 ----------
extr = Extrude(Base=rectangle_2.Rectangle, Direction=Z)
panel_2 = Panel(pyballrun_3.out)
cap = CapHoles(Brep=extr)
preview = CustomPreview(
    Geometry=cap,
    Material={diffuse=RGB(120, 120, 120), emission=RGB(36, 36, 36), shine=0.5, specular=RGB(255, 255, 255), transparency=0})
sph_3 = Sphere(Base=pyballrun_3.pt, Radius=Slider(3, range=0..10))

# ---- group: FINISHED GAME / Ripple
mesh = Mesh(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)
pyripplesetup = GhPythonScript(mesh=mesh, rad=Slider(60, range=0..100), reset=new_game)  # -> out, myRipple
# ---------- pyripplesetup: Python ----------
__author__ = "Shawn Wang"
__version__ = "2020.08.30"

import rhinoscriptsyntax as rs
import math

class Cell():
    
    def __init__(self, _coor, _index):
        self.coor = _coor
        self.index = _index
        self.state = 0
    
    def findNeighbors(self, mesh, rad):
        self.neighbors = []
        """
        faces = rs.MeshFaceVertices(mesh)
        faceIndexes = rs.MeshVertexFaces(mesh,self.index)
        for faceIndex in faceIndexes:
            thisFace = faces[faceIndex]
            for vtxIndex in thisFace:
                if vtxIndex != self.index:
                    if vtxIndex not in self.neighbors:
                        self.neighbors.append(vtxIndex)
        """
        vtxs = rs.MeshVertices(mesh)
        for i,vtx in enumerate(vtxs):
            dist = rs.Distance(self.coor,vtx)
            if dist<rad*math.sqrt(2):
                self.neighbors.append(i)
        

class Ripple():
    
    def __init__(self,mesh,rad):
        
        self.vtxs = rs.MeshVertices(mesh)
        self.cells = []
        for i,vtx in enumerate(self.vtxs):
            myCell = Cell(vtx,i)
            myCell.findNeighbors(mesh,rad)
            self.cells.append(myCell)
            
        
        
    
    def rules(self, ballPt, damping):
        newStates = []
        
        for i,myCell in enumerate(self.cells):
            sum = 0
            for neighborIndex in myCell.neighbors:
                neighborCell = self.cells[neighborIndex]
                sum = sum + neighborCell.state
            sum = 2*sum / (len(myCell.neighbors))
            #sum = sum - myCell.state
            newStates.append(sum)
        
        
        for i,myCell in enumerate(self.cells):
            myCell.state = (myCell.state - newStates[i])*damping
            
            ##################################################
            #check the ball point
            dist = rs.Distance(myCell.coor, ballPt)
            if dist<30:
                myCell.state = 1
            
        


myRipple = Ripple(mesh,rad)
# ---------- end pyripplesetup ----------
python = GhPythonScript(myRipple=pyripplesetup.myRipple, ballPt=pyballrun_3.pt, damping=Slider(0.75, range=0..1))  # -> out, states
# ---------- python: Python ----------
__author__ = "maeta"
__version__ = "2020.08.30"

import rhinoscriptsyntax as rs

myRipple.rules(ballPt,damping)
states = []
for myCell in myRipple.cells:
    states.append(myCell.state)
# ---------- end python ----------

# ---- group: FINISHED GAME / Bricks
gradient = Gradient(
    LowerLimit=0,
    UpperLimit=1,
    Parameter=python.states,
    stops=[0: RGB(255, 255, 255), 0.25: RGB(234, 126, 0), 0.5: RGB(254, 244, 84), 0.75: RGB(173, 203, 249), 1: RGB(75, 107, 169)])
demesh = DeconstructMesh(Mesh=mesh)  # -> Vertices, Faces, Colours, Normals
number_slider_7 = Slider(5, range=0..10)
number_slider_8 = Slider(2, range=0..10)
multiplication = Multiplication(A=python.states, B=Slider(5, range=0..10))
Z_2 = UnitZ(Factor=multiplication)

box_6 = CenterBox(Base=demesh.Vertices, X=number_slider_7, Y=number_slider_7, Z=number_slider_8)
mbox = MeshBox(Base=box_6, XCount=1, YCount=1, ZCount=1)

move = Move(Geometry=mbox, Motion=Z_2)  # -> Geometry, Transform
preview_2 = CustomPreview(Geometry=move.Geometry, Material=gradient)
